% Simulink data dictionary FOC_CURRENTLOOP_DOUBLE.sldd

Rs = Simulink.Parameter(0.1763)
Ls = Simulink.Parameter(0.000195185)
flux = Simulink.Parameter(0.0109)
bandwidth = Simulink.Parameter(1256.637)
PWMHalfPeriod = Simulink.Parameter(4199)
TsFOC = Simulink.Parameter(0.0001)
PWMHalfPeriod_MODEL = Simulink.Parameter(4199)
Polepairs = Simulink.Parameter(5)
Polepairs_MODEL = Simulink.Parameter(5)
Rs_MODEL = Simulink.Parameter(0.1763)
Ls_MODEL = Simulink.Parameter(0.000195185)
flux_MODEL = Simulink.Parameter(0.0109)
TsBSP = Simulink.Parameter(5.0e-5)
i_alpha_clark = Simulink.Signal(StorageClass="Struct", StructName="i_alpha_T")
i_beta_clark = Simulink.Signal(StorageClass="Struct", StructName="i_alpha_T")
tAout = Simulink.Signal(StorageClass="Struct", StructName="mcuDuty")
tBout = Simulink.Signal(StorageClass="Struct", StructName="mcuDuty")
tCout = Simulink.Signal(StorageClass="Struct", StructName="mcuDuty")
TEST_CONST_TWJ = Simulink.Parameter(100, StorageClass="Define")

ClarkeInput = Simulink.Bus(DataScope="Imported", HeaderFile="jscl_clarke.h")
  ia: double
  ib: double
  ic: double

VectorAB_T = Simulink.Bus(DataScope="Imported", HeaderFile="jscl_transform.h")
  s64_alpha: double
  s64_beta: double

VectorUVW_T = Simulink.Bus(DataScope="Imported", HeaderFile="jscl_transform.h")
  s64_u: double
  s64_v: double
  s64_w: double

VectorDQ_T = Simulink.Bus(DataScope="Imported", HeaderFile="jscl_transform.h")
  s64_d: double
  s64_q: double

SinCos_T = Simulink.Bus()
  m_sin: double
  m_cos: double

u_current = Simulink.Parameter([], StorageClass="Struct", StructName="measureCurrent", DataType="Bus: VectorUVW_T")
v_current = Simulink.Parameter([], StorageClass="Struct", StructName="measureCurrent", DataType="Bus: VectorUVW_T")
w_current = Simulink.Parameter([], StorageClass="Struct", StructName="measureCurrent", DataType="Bus: VectorUVW_T")
s16_PwmOnTicks = Simulink.Signal(StorageClass="ExportedGlobal", Alias="s16_PwmOnTicks", DataType="double", Dimensions=3)
measureCureent_s = Simulink.Signal(StorageClass="ExportedGlobal", Alias="measureCureent_s", DataType="Bus: VectorUVW_T")
s16_PwmOnTicks1 = Simulink.Parameter([], StorageClass="ExportedGlobal", Alias="s16_PwmOnTicks", DataType="double")
D_AXIS_KP_PARAM = Simulink.Parameter(Simulink.data.Expression(ExpressionString="Ls*bandwidth"))
Sig = Simulink.Signal()
TS_SPEED = Simulink.Parameter(0.001)

MATH_Scalar_MinimalJerkParameterT = Simulink.Bus(HeaderFile="minimaljerkramp.h")
  s64_MaximumJerk: double
  s64_MaximumAcceleration: double
  s64_MinimumAcceleration: double

MATH_Scalar_MinimalJerkStateT = Simulink.Bus()
  s64_CurrentSpeed: double
  s64_CurrentAcceleration: double

MATH_Scalar_MinimalJerkOutputT = Simulink.Bus()
  s64_Output: double
  b_Settled: double

LADRC_b0 = Simulink.Parameter(8000)
LADRC_Omega_c = Simulink.Parameter(150)
Sig1 = Simulink.Signal()