% Simulink data dictionary Copy_of_FOC_CURRENTLOOP_F103.sldd

flux = Simulink.Parameter(0.0109)
TsFOC = Simulink.Parameter(0.0001)
Polepairs = Simulink.Parameter(5)
Polepairs_MODEL = Simulink.Parameter(5)
Rs_MODEL = Simulink.Parameter(0.1763)
Ls_MODEL = Simulink.Parameter(0.000195185)
flux_MODEL = Simulink.Parameter(0.0109)
TsBSP = Simulink.Parameter(5.0e-5)
Rs = Simulink.Parameter(0.1763)
Ls = Simulink.Parameter(0.000195185)
bandwidth = Simulink.Parameter(1256.637)
PWMHalfPeriod = Simulink.Parameter(3199)
PWMHalfPeriod_MODEL = Simulink.Parameter(3199)