% Simulink data dictionary FOC_CURRENTLOOP_F103.sldd

flux = Simulink.Parameter(0.0109)
TsFOC = Simulink.Parameter(0.0001)
Polepairs = Simulink.Parameter(5)
Polepairs_MODEL = Simulink.Parameter(5)
Rs_MODEL = Simulink.Parameter(0.1763)
Ls_MODEL = Simulink.Parameter(0.000195185)
flux_MODEL = Simulink.Parameter(0.0109)
TsBSP = Simulink.Parameter(5.0e-5)
PWMHalfPeriod_MODEL = Simulink.Parameter(3199)
Ls = Simulink.Parameter(0.000195185, DataType="fixdt(0,16,28)")
PWMHalfPeriod = Simulink.Parameter(3199, DataType="fixdt(0,16,4)")
Rs = Simulink.Parameter(0.1763, DataType="fixdt(0,16,18)")
bandwidth = Simulink.Parameter(1256.637, DataType="fixdt(0,16,5)")